# Grasshopper definition error_viz_tester_components.ghx (Grasshopper 1.0.8)
# plug-ins: RhinoCodePluginGH, MeshEdit Components, Bifocals

panel = Panel("""0
1
2
3""")

construct_point = ConstructPoint(XCoordinate=Slider(1, range=0..1), YCoordinate=Slider(0, range=0..1), ZCoordinate=Slider(0, range=0..1))
mesh = Mesh(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)
move = Move(Geometry=mesh, Motion=construct_point)  # -> Geometry, Transform
volume = Volume(Geometry=move.Geometry)  # -> Volume, Centroid
scale = Scale(Geometry=move.Geometry, Center=volume.Centroid, Factor=Slider(1.1, range=0..10))  # -> Geometry, Transform
number_slider = Slider(200, range=0..600)
mesh_explode = MeshExplode(Mesh=mesh, Interpolate=False)
mesh_explode_2 = MeshExplode(Mesh=scale.Geometry, Interpolate=False)
populate_geometry = PopulateGeometry(Geometry=mesh_explode_2, Count=number_slider, Seed=Slider(2, range=0..10))  # -> simplify(Population)
populate_geometry_2 = PopulateGeometry(Geometry=mesh_explode, Count=number_slider, Seed=1)
flatten_tree = FlattenTree(Tree=populate_geometry_2, Path="{0}")
flatten_tree_2 = FlattenTree(Tree=populate_geometry, Path="{0}")
point_cloud_attributes = PointCloudAttributes(Locations=flatten_tree)  # -> Cloud, Locations, Normals, Colours, Extra, Hidden
point_cloud_attributes_2 = PointCloudAttributes(Locations=flatten_tree_2)  # -> Cloud, Locations, Normals, Colours, Extra, Hidden
move_2 = Move(Geometry=point_cloud_attributes.Cloud, Motion=Vector(0, 0, 10))  # -> Geometry, Transform

df_histogram_scale_factor = Slider(0.001, range=0..1)
panel_2 = Panel("diffCheck")
df_palette = ValueList({"Jet", "Rainbow", "RdPu", "Viridis"}, selected="Rainbow")
df_value_t = ValueList({"Dist", "RMSE", "MAX", "MIN", "STD"}, selected="Dist")
df_upper_threshold = Slider(1.054, range=0..5)
df_lower_threshold = Slider(0, range=0..5)
point_cloud = PointCloud([point_cloud_attributes.Cloud, move_2.Geometry])
point_cloud_2 = PointCloud([point_cloud_attributes_2.Cloud, move_2.Geometry])
df_legend_height = Slider(10, range=0..20)
df_legend_width = Slider(0.5, range=0..2)
dfcloudclouddistance = DFCloudCloudDistance(i_cloud_source=point_cloud, i_cloud_target=point_cloud_2, i_swap=Toggle(False))  # -> o_distances, o_rmse, o_max_deviation, o_min_deviation, o_std_deviation, o_result; inputs i_cloud_source: list, i_cloud_target: list, i_swap: Boolean
#   port i_cloud_source: The source point cloud.
#   port i_cloud_target: The target cloud.
#   port i_swap: whether to swap source and target
#   port o_result: The result of the distance calculation.
# ---------- dfcloudclouddistance: Python ----------
#! python3

import System
import typing

import Rhino
import Rhino.Geometry as rg
from ghpythonlib.componentbase import executingcomponent as component

import Grasshopper as gh
from Grasshopper.Kernel import GH_RuntimeMessageLevel as RML

import diffCheck
from diffCheck import df_cvt_bindings
from diffCheck import df_error_estimation

import diffCheck.df_util


class CloudCloudDistance(component):
    def RunScript(self,
        i_cloud_source:  typing.List[rg.PointCloud],
        i_cloud_target: typing.List[rg.PointCloud],
        i_swap: bool):
        """
            The cloud-to-cloud component computes the distance between each point in the source point cloud and its nearest neighbour in thr target point cloud.

            :param i_cloud_source: a list of source point cloud
            :param i_cloud_target: a list of target point cloud to calculate distances to

            :return o_distances : list of calculated distances for each point
            :return o_rmse: the root mean squared error between corresponding points of source and target
            :return o_max_deviation: the max deviation between source and target
            :return o_min_deviation: the min deviation between source and target
            :return o_std_deviation: the standard deviation between source and target
            :returns o_resluts: the results of the comparison all in one object
        """

        if i_cloud_source is None or i_cloud_target is None:
            ghenv.Component.AddRuntimeMessage(RML.Warning, "Please provide both objects of type point clouds to compare")
            return None

        # swap
        if i_swap is True:
            temp = i_cloud_source
            i_cloud_source = i_cloud_target
            i_cloud_target = temp

        # conversion
        df_cloud_source_list = [df_cvt_bindings.cvt_rhcloud_2_dfcloud(i_cl_s) for i_cl_s in i_cloud_source]
        df_cloud_target_list = [df_cvt_bindings.cvt_rhcloud_2_dfcloud(i_cl_t) for i_cl_t in i_cloud_target]

        # calculate distances
        o_results = df_error_estimation.df_cloud_2_df_cloud_comparison(df_cloud_source_list, df_cloud_target_list)

        return o_results.distances, o_results.distances_rmse, o_results.distances_max_deviation, o_results.distances_min_deviation, o_results.distances_sd_deviation, o_results


# if __name__ == "__main__":
#     com = CloudCloudDistance()
#     o_distances, o_rmse, o_max_deviation, o_min_deviation, o_std_deviation, o_results = com.RunScript(
#         i_cloud_source,
#         i_cloud_target,
#         i_swap
#         )
# ---------- end dfcloudclouddistance ----------
df_legend_plane = Plane()
dfvisualizationsettings = DFVisualizationSettings(i_value_type=df_value_t, i_palette=df_palette, i_histogram_scale_factor=df_histogram_scale_factor)  # -> o_viz_settings; inputs i_value_type: String, i_upper_threshold: Double, i_lower_threshold: Double, i_palette: String, i_legend_height: Double, i_legend_width: Double, i_legend_plane: Plane, i_histogram_scale_factor: Double
#   port i_legend_height: Set the total height of the legend
#   port i_legend_width: Set the total width of the legend
#   port i_legend_plane: A construction plane for the legend
#   port o_viz_settings: Settings to be passed to the Visualization component
# ---------- dfvisualizationsettings: Python ----------
#! python3

import System
import typing

import Rhino
import Rhino.Geometry as rg
from ghpythonlib.componentbase import executingcomponent as component

import Grasshopper as gh
from Grasshopper.Kernel import GH_RuntimeMessageLevel as RML

from diffCheck import df_visualization

class VisualizationSettings(component):
    def RunScript(self,
        i_value_type: str,
        i_upper_threshold: float,
        i_lower_threshold: float,
        i_palette: str,
        i_legend_height: float,
        i_legend_width: float,
        i_legend_plane: rg.Plane,
        i_histogram_scale_factor: float):

        """
        Compiles all the visualization settings to feed to the visualization component

        :param i_value_type: selected type indicates Which values to display. Possible values: "dist", "RMSE", "MAX", "MIN", "STD"
        :param i_upper_threshold: Thresholds the values with a maximum value
        :param i_lower_threshold: Thresholds the values with a minimum value
        :param i_palette: Select a color palette to map the values to. Possible values: "Jet", "Rainbow", "RdPu", "Viridis"
        :param i_legend_height: the total height of the legend
        :param i_legend_width: the total width of the legend
        :param i_legend_plane: the construction plane of the legend
        :param i_histogram_scale_factor: Scales the height of the histogram with a factor

        :returns o_viz_settings: the results of the comparison all in one object
        """

        
        if i_palette not in  ["Jet", "Rainbow", "RdPu", "Viridis"]:
            ghenv.Component.AddRuntimeMessage(RML.Warning, "Possible values for i_palette are: Jet, Rainbow, RdPu, Viridis")
            return None
        
        if i_value_type not in  ["Dist", "RMSE", "MAX", "MIN", "STD"]:
            ghenv.Component.AddRuntimeMessage(RML.Warning, "Possible values for i_value_type are: dist, RMSE, MAX, MIN, STD")
            return None
        
        # set default values
        if i_legend_height is None: i_legend_height = 10
        if i_legend_width is None: i_legend_width = 0.5
        if i_legend_plane is None: i_legend_plane = rg.Plane.WorldXY
        if i_histogram_scale_factor is None: i_histogram_scale_factor = 0.01

        # pack settings
        o_viz_settings = df_visualization.DFVizSettings(i_value_type,
                                                        i_upper_threshold,
                                                        i_lower_threshold,
                                                        i_palette,
                                                        i_legend_height,
                                                        i_legend_width,
                                                        i_legend_plane,
                                                        i_histogram_scale_factor)

        return o_viz_settings

# if __name__ == "__main__":
#     com = VisualizationSettings()
#     o_viz_settings = com.RunScript(
#         i_value_type,
#         i_upper_threshold,
#         i_lower_threshold,
#         i_palette,
#         i_legend_height,
#         i_legend_width,
#         i_legend_plane,
#         i_histogram_scale_factor
#         )
# ---------- end dfvisualizationsettings ----------
file_path = FilePath("C:\Users\eleni\Desktop\DC\temp")
dfvisualization = DFVisualization(i_result=dfcloudclouddistance.o_result)  # -> o_colored_geo, o_legend, o_histogram
#   port i_result: The result of the distance calculation
#   port i_viz_settings: The settings of the visualization
#   port o_colored_geo: The geometry colored according to the distance results.
#   port o_legend: The legend of the visualization
#   port o_histogram: Histogram that shows the frequency of the values
# ---------- dfvisualization: Python ----------
#! python3

import System
import typing

import Rhino
import Rhino.Geometry as rg
from ghpythonlib.componentbase import executingcomponent as component

import Grasshopper as gh
from Grasshopper.Kernel import GH_RuntimeMessageLevel as RML

from diffCheck import df_cvt_bindings
from diffCheck import df_visualization
from diffCheck.df_visualization import DFVizSettings
from diffCheck.df_error_estimation import DFVizResults
from diffCheck import diffcheck_bindings

class Visualization(component):
    def RunScript(self,
                  i_result: DFVizResults,
                  i_viz_settings: DFVizSettings):

        """
            Adds color to the mesh or point cloud
            and generates a corresponding legend and histogram

            :param i_result: a list of point clouds
            :param i_viz_settings: a list of DF beams

            :return o_colored_geo: the colored mesh or point cloud
            :return o_legend : the correesponding legend of the coloring
            :return o_histogram : a histogram that represents the frequency of the values
        """

        values, min_value, max_value = i_result.filter_values_based_on_valuetype(i_viz_settings)

        # check if i_result.source is a list of pointclouds or a mesh
        if type(i_result.source[0]) is diffcheck_bindings.dfb_geometry.DFPointCloud:

            # convert to Rhino PCD
            o_source = [df_cvt_bindings.cvt_dfcloud_2_rhcloud(src) for src in i_result.source]

            # color geometry
            o_colored_geo = [df_visualization.color_rh_pcd(src, dist, min_value, max_value, i_viz_settings.palette) for src, dist in zip(o_source, values)]

        elif type(i_result.source[0]) is rg.Mesh:
            # convert to Rhino Mesh
            o_source = i_result.source

            # color geometry
            o_colored_geo = [df_visualization.color_rh_mesh(src, dist, min_value, max_value, i_viz_settings.palette) for src, dist in zip(o_source, values)]

        o_legend = df_visualization.create_legend(min_value,
                                                  max_value,
                                                  i_viz_settings.palette,
                                                  steps=10,
                                                  plane=i_viz_settings.legend_plane,
                                                  width=i_viz_settings.legend_width,
                                                  total_height=i_viz_settings.legend_height)

        o_histogram = df_visualization.create_histogram(values,
                                                        min_value,
                                                        max_value,
                                                        steps=100,
                                                        plane=i_viz_settings.legend_plane,
                                                        total_height=i_viz_settings.legend_height,
                                                        scaling_factor=i_viz_settings.histogram_scale_factor)

        return o_colored_geo, o_legend, o_histogram


# if __name__ == "__main__":
#     com = Visualization()
#     o_colored_geo, o_legend, o_histogram  = com.RunScript(
#         i_result,
#         i_viz_settings
#         )
# ---------- end dfvisualization ----------
dfcsvexporter = DFCsvExporter(
    i_dump=Button(),
    i_export_dir=file_path,
    i_file_name="assembly",
    i_export_seperate_files=Toggle(True),
    i_result=dfcloudclouddistance.o_result)  # -> o_success; inputs i_dump: Boolean, i_export_dir: String, i_file_name: String, i_export_seperate_files: Boolean
#   port i_file_name: The name for the file.
#   port i_export_seperate_files: Whether to export one single file or seperate files per element.
#   port i_result: The result of the distance calculation to export
#   port o_success: Whether the values exported successfully
# ---------- dfcsvexporter: Python ----------
#! python3

import System
import typing

import Rhino
import Rhino.Geometry as rg
from ghpythonlib.componentbase import executingcomponent as component

import Grasshopper as gh
from Grasshopper.Kernel import GH_RuntimeMessageLevel as RML
from diffCheck.df_error_estimation import DFVizResults
import csv
import os


class CsvExporter(component):
    def RunScript(self,
        i_dump: bool,
        i_export_dir: str,
        i_file_name: str,
        i_export_seperate_files: bool,
        i_result: DFVizResults):
        """
            The csv-exporter component exports a list of values to a .csv file

            :param i_dump: A flag indicating whether to perform the export.
            :param i_export_dir: The directory where the CSV file will be saved.
            :param i_file_name: The name of the file
            :param i_export_seperate_files: whether to export a different file for each part
            :param i_values: A list of values to be exported.

            :return o_success: A string notifying the user for the successful export
        """
        if i_dump:
            # Ensure the export directory exists
            os.makedirs(i_export_dir, exist_ok=True)

            if i_export_seperate_files:
                # Export each list of values to a separate file
                for idx, list_of_values in enumerate(i_result.distances):
                    file_name = f"{i_file_name}_{idx + 1}.csv"
                    file_path = os.path.join(i_export_dir, file_name)
                    with open(file_path, mode='w', newline='') as file:
                        writer = csv.writer(file)
                        writer.writerow([list_of_values])
            else:
                # Export all values to a single file
                file_path = os.path.join(i_export_dir, f"{i_file_name}.csv")
                with open(file_path, mode='w', newline='') as file:
                    writer = csv.writer(file)
                    for list_of_values in i_result.distances:
                        writer.writerow([list_of_values])

            o_success = "Successfully exported the values"

            return o_success


# if __name__ == "__main__":
#     com = CsvExporter()
#     o_cvs = com.RunScript(
#         i_dump,
#         i_export_dir,
#         i_file_name,
#         i_export_seperate_files,
#         i_results
#     )
# ---------- end dfcsvexporter ----------

reciprocal = Brep([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])
unit_z = UnitZ(Factor=Slider(0.1, range=0..18))

list_item = ListItem(List=reciprocal, Index=panel, Wrap=True)
dfbuildassembly = DFBuildAssembly(i_assembly_name="test", i_breps=list_item)  # -> o_assembly; inputs i_assembly_name: String, i_breps: list of Brep
#   port i_assembly_name: The name of the assembly to export.
#   port i_breps: The breps of the structure.
#   port o_assembly: The create DFAssembly object representing the timber elements.
# ---------- dfbuildassembly: Python ----------
#! python3

import System
import typing

import Rhino
import Rhino.Geometry as rg
import scriptcontext as sc

from ghpythonlib.componentbase import executingcomponent as component

import diffCheck
from diffCheck.df_geometries import DFBeam, DFAssembly


class DFBuildAssembly(component):
    def RunScript(self,
            i_assembly_name,
            i_breps : System.Collections.Generic.IList[Rhino.Geometry.Brep]):
        """
            This component parse a series of breps representing a timber structure or a 
            timber elements into a DFAssembly object.
            
            :param i_assembly_name: the name of the assembly
            :param i_breps: list of breps

            :return o_assembly: the DFAssembly object
        """
        beams: typing.List[DFBeam] = []
        for brep in i_breps:
            beam = DFBeam.from_brep_face(brep)
            beams.append(beam)

        o_assembly = DFAssembly(beams, i_assembly_name)

        return o_assembly


# if __name__ == "__main__":
#     comp = DFBuildAssembly()
#     o_assembly = comp.RunScript(
#         i_assembly_name,
#         i_breps
#     )
# ---------- end dfbuildassembly ----------

dfdeconstructassembly = DFDeconstructAssembly(i_assembly=dfbuildassembly)  # -> o_beams
#   port i_assembly: The DFAssembly object to deconstruct.
#   port o_beams: The set of beams contained by this DFAssembly object.
# ---------- dfdeconstructassembly: Python ----------
#! python3

import System
import typing

import Rhino
import Rhino.Geometry as rg
import scriptcontext as sc

from ghpythonlib.componentbase import executingcomponent as component

import diffCheck
from diffCheck.df_geometries import DFBeam, DFAssembly


class DFDeconstructAssembly(component):
    def RunScript(self,
            i_assembly):
        """
            Deconstruct the DFAssembly into a set of df_beams objects.
            
            :param i_assembly: the DFAssembly object

            :return o_beams
        """
        o_beams = i_assembly.beams

        return o_beams


# if __name__ == "__main__":
#     comp = DFDeconstructAssembly()
#     o_beams = comp.RunScript(
#         i_assembly
#     )
# ---------- end dfdeconstructassembly ----------
dfdeconstructbeam = DFDeconstructBeam(i_beams=graft(dfdeconstructassembly))  # -> simplify(o_side_faces), simplify(o_joint_faces), o_joint_ids; inputs i_beams: list
#   port i_beams: The DFBeam objects to deconstruct.
#   port o_side_faces: The side faces of as Breps of the beam.
#   port o_joint_faces: The faces as Breps belonging to joints of the beam.
#   port o_joint_ids: An integer indicating to which joint the joint faces are belonging to.
# ---------- dfdeconstructbeam: Python ----------
#! python3

import System
import typing

import Rhino
import Rhino.Geometry as rg
import scriptcontext as sc

from ghpythonlib.componentbase import executingcomponent as component

import diffCheck
from diffCheck.df_geometries import DFBeam, DFAssembly


class DFDeconstructBeam(component):
    def RunScript(self,
            i_beams : typing.List[DFBeam]):
        """
            Deconstruct the DFBeam object into Rhino objects.
            
            :param i_beams: the DFBeam objects

            :return o_side_faces: the side joints of the beam
            :return o_joint_faces: the face joints of the beam
            :return o_joint_ids: the ids for each face joint
        """
        o_side_faces, o_joint_faces, o_joint_ids, o_breps = [], [], [], []

        for i_b in i_beams:
            o_side_faces = [f.to_brep_face() for f in i_b.side_faces]
            o_joint_faces = [f.to_brep_face() for f in i_b.joint_faces]
            o_joint_ids = [f.joint_id for f in i_b.joint_faces]

        return o_side_faces, o_joint_faces, o_joint_ids

# if __name__ == "__main__":
#     comp = DFDeconstructBeam()
#     o_side_faces, o_joint_faces, o_joint_ids = comp.RunScript(
#         i_beams
#     )
# ---------- end dfdeconstructbeam ----------

merge = Merge(Data1=dfdeconstructbeam.o_side_faces, Data2=dfdeconstructbeam.o_joint_faces)

populate_geometry_3 = PopulateGeometry(Geometry=merge, Count=number_slider, Seed=1)

trim_tree = TrimTree(Tree=populate_geometry_3, Depth=1)

point_cloud_attributes_3 = PointCloudAttributes(Locations=trim_tree)  # -> Cloud, Locations, Normals, Colours, Extra, Hidden
move_3 = Move(Geometry=flatten(point_cloud_attributes_3.Cloud), Motion=unit_z)  # -> Geometry, Transform

dfnormalsegmentator = DFNormalSegmentator(i_cloud=point_cloud_attributes_3.Cloud)  # -> o_clusters; inputs i_normal_threshold_degree: Double, i_min_cluster_size: Int32, i_use_knn_neighborhood: Boolean, i_knn_neighborhood_size: Int32, i_radius_neighborhood_size: Double
#   port i_cloud: The point cloud to reduce the size.
#   port i_normal_threshold_degree: The normal threshold in degrees (under that it consider to the same cluster).
#   port i_min_cluster_size: The smallest cluster allowed.
#   port i_use_knn_neighborhood: If true use knn, otherwise radius search.
#   port i_knn_neighborhood_size: The knn size.
#   port i_radius_neighborhood_size: The size of the radius.
#   port o_clusters: The segmented clouds.
# ---------- dfnormalsegmentator: Python ----------
#! python3

import System
import typing

import Rhino
import Rhino.Geometry as rg
from ghpythonlib.componentbase import executingcomponent as component

import Grasshopper as gh
from Grasshopper.Kernel import GH_RuntimeMessageLevel as RML

import diffCheck
import diffCheck.df_geometries
from diffCheck.diffcheck_bindings import dfb_segmentation

from diffCheck import df_cvt_bindings


class DFCloudNormalSegmentator(component):
    def RunScript(self,
        i_cloud,
        i_normal_threshold_degree=None,
        i_min_cluster_size=None,
        i_use_knn_neighborhood=None,
        i_knn_neighborhood_size=None,
        i_radius_neighborhood_size=None
    ) -> rg.PointCloud:
        """
            Segment a point cloud into clusters based on normals.

            :param i_cloud: Point cloud to segment.
            :param i_normal_threshold_degree: Threshold in degrees to consider a normal as a cluster.
            :param i_min_cluster_size: Minimum size of a cluster.
            :param i_use_knn_neighborhood: Use KNN neighborhood.
            :param i_knn_neighborhood_size: Size of the KNN neighborhood.
            :param i_radius_neighborhood_size: Size of the radius neighborhood.
        """
        o_clusters = []
        df_cloud = df_cvt_bindings.cvt_rhcloud_2_dfcloud(i_cloud)

        if i_normal_threshold_degree is None:
            i_normal_threshold_degree = 20
        if i_min_cluster_size is None:
            i_min_cluster_size = 10
        if i_use_knn_neighborhood is None:
            i_use_knn_neighborhood = True
        if i_knn_neighborhood_size is None:
            i_knn_neighborhood_size = 30
        if i_radius_neighborhood_size is None:
            i_radius_neighborhood_size = 0.1

        o_clusters = dfb_segmentation.DFSegmentation.segment_by_normal(
            point_cloud=df_cloud,

            normal_threshold_degree=i_normal_threshold_degree,
            min_cluster_size=i_min_cluster_size,
            use_knn_neighborhood=i_use_knn_neighborhood,
            knn_neighborhood_size=i_knn_neighborhood_size,
            radius_neighborhood_size=i_radius_neighborhood_size
        )

        return [df_cvt_bindings.cvt_dfcloud_2_rhcloud(cluster) for cluster in o_clusters]

# if __name__ == "__main__":
#     com = DFCloudNormalSegmentator()
#     o_clusters = com.RunScript(
#         i_cloud,
#         i_normal_threshold_degree,
#         i_min_cluster_size,
#         i_use_knn_neighborhood,
#         i_knn_neighborhood_size,
#         i_radius_neighborhood_size
#         )
# ---------- end dfnormalsegmentator ----------
dfjointsegmentator = DFJointSegmentator(
    i_clusters=dfnormalsegmentator,
    i_joint_faces=dfdeconstructbeam.o_joint_faces,
    i_joint_ids=dfdeconstructbeam.o_joint_ids,
    i_angle_threshold=Slider(1, range=0..1))  # -> o_joint_segments, o_transforms, o_reference_point_clouds; inputs i_clusters: list, i_joint_faces: list of Mesh, i_joint_ids: list of Int32, i_angle_threshold: Double, i_association_threshold: Double
#   port i_clusters: The cluster point clouds from normal segmentation.
#   port i_joint_faces: The joints to extract and analyze
#   port i_joint_ids: The joint ids of the assembly
#   port i_angle_threshold: From 0 to 1, it's the sin value. By default 0.1. The closer to 0 the less permissive and viceversa to 1.
#   port i_association_threshold: From 0 to infinite. By default 0.1. The closer to 0 the less permissive your point.
#   port o_joint_segments: The extracted joints.
#   port o_transforms: The transformations for each joint.
#   port o_reference_point_clouds: The reference point clouds of the joints. They are generated from the
# ---------- dfjointsegmentator: Python ----------
#! python3

import Rhino

import diffCheck
from diffCheck import diffcheck_bindings
from diffCheck import df_cvt_bindings as df_cvt
import diffCheck.df_util

from ghpythonlib.componentbase import executingcomponent as component

ABSTOL = Rhino.RhinoDoc.ActiveDoc.ModelAbsoluteTolerance

class DFJointSegmentator(component):
    def RunScript(self, 
                  i_clusters: Rhino.Geometry.PointCloud, 
                  i_joints: Rhino.Geometry.Mesh, 
                  i_joint_ids: int,
                  i_angle_threshold: float,
                  i_distance_threshold: float):
        """
        Amongst clusters, associates the clusters to the individual joints, 
        creates a reference point cloud for each joint, 
        and returns the joint segments, the reference point clouds, and the ICP transformations from the first to the second.

        :param i_clusters: The clusters to be associated to the joints.
        :param i_joints: The joints to which the clusters will be associated. These are meshes.
        :param i_joint_ids: The joint ids of the joints.
        :param i_angle_threshold: The angle threshold for the association of the clusters to the joints.
        :param i_distance_threshold: The distance threshold for the association of the clusters to the joints.
        """
        if i_angle_threshold is None : i_angle_threshold = 0.1
        if i_distance_threshold is None : i_distance_threshold = 0.1

        if len(i_joints) != len(i_joint_ids):
            raise ValueError("The number of joints and joint ids must be the same.")
        
        if len(i_clusters) == 0:
            raise ValueError("No clusters given.")

        if not isinstance(i_clusters[0], Rhino.Geometry.PointCloud):
            raise ValueError("The input clusters must be PointClouds.")
        
        if not isinstance(i_joints[0], Rhino.Geometry.Mesh):
            raise ValueError("The input joints must be convertible to Meshes.")
            

        # prepping the reference meshes
        n_joints = max(i_joint_ids) + 1
        joints = [ [] for i in range(n_joints) ]
        for face, id in zip(i_joints, i_joint_ids):
            face.Subdivide()
            face.Faces.ConvertQuadsToTriangles()
            joints[id].append(df_cvt.cvt_rhmesh_2_dfmesh(face))

        joint_clouds = []
        registrations = []
        joint_segments = []
        df_clouds = [df_cvt.cvt_rhcloud_2_dfcloud(cluster) for cluster in i_clusters]

        # for each joint, find the corresponding clusters and merge them, generate a reference point cloud, and register the merged clusters to the reference point cloud
        for joint in joints:

            # create the reference point cloud
            joint_cloud = diffcheck_bindings.dfb_geometry.DFPointCloud()

            for face in joint:
                face_cloud = face.sample_points_uniformly(1000)
                joint_cloud.add_points(face_cloud)

            joint_clouds.append(df_cvt.cvt_dfcloud_2_rhcloud(joint_cloud))

            # find the corresponding clusters and merge them
            segment = diffcheck_bindings.dfb_segmentation.DFSegmentation.associate_clusters(joint, df_clouds, i_angle_threshold, i_distance_threshold)
            diffcheck_bindings.dfb_segmentation.DFSegmentation.clean_unassociated_clusters(df_clouds, [segment], [joint], i_angle_threshold ,i_distance_threshold)

            # register the merged clusters to the reference point cloud
            registration = diffcheck_bindings.dfb_registrations.DFRefinedRegistration.O3DICP(segment, joint_cloud)
            res = registration.transformation_matrix

            registrations.append(df_cvt.cvt_ndarray_2_rh_transform(res))
            joint_segments.append(df_cvt.cvt_dfcloud_2_rhcloud(segment))

        return joint_segments, registrations, joint_clouds

# if __name__ == "__main__":
#     o_joint_segments, o_reference_point_clouds, o_transforms = main(i_clusters, i_joints, i_joint_ids)

#     for i in range(len(o_joint_segments)):
#         o_joint_segments[i].Transform(o_transforms[i])
# ---------- end dfjointsegmentator ----------
move_4 = Move(Geometry=flatten(dfjointsegmentator.o_reference_point_clouds), Motion=unit_z)  # -> Geometry, Transform
beams_pcd = PointCloud(flatten(move_3.Geometry))
joints_pcd = PointCloud(flatten(move_4.Geometry))
dfcloudmeshdistance = DFCloudMeshDistance(i_cloud_source=joints_pcd, i_assembly=dfbuildassembly, i_signed_flag=Toggle(True), i_swap=Toggle(False))  # -> o_distances, o_rmse, o_max_deviation, o_min_deviation, o_std_deviation, o_result; inputs i_cloud_source: list, i_signed_flag: Boolean, i_swap: Boolean, i_analysis_resolution: Double
#   port i_cloud_source: The source point cloud.
#   port i_assembly: The target DFAssembly
#   port i_signed_flag: whether to consider the sign of the distances
#   port i_swap: whether to swap source and target
#   port i_analysis_resolution: the maximum edge length of the mesh that is used for the distance calculation
#   port o_rmse: average squared difference between source and target.
#   port o_std_deviation: standard deviation between source and target.
#   port o_result: The result of the distance calculation.
# ---------- dfcloudmeshdistance: Python ----------
#! python3

import System
import typing

import Rhino
import Rhino.Geometry as rg
from ghpythonlib.componentbase import executingcomponent as component

import Grasshopper as gh
from Grasshopper.Kernel import GH_RuntimeMessageLevel as RML

import diffCheck
from diffCheck import df_cvt_bindings
from diffCheck import df_error_estimation
from diffCheck.df_geometries import DFAssembly


class CloudMeshDistance(component):
    def RunScript(self,
        i_cloud_source: typing.List[rg.PointCloud],
        i_assembly: DFAssembly,
        i_signed_flag: bool,
        i_swap: bool,
        i_analysis_resolution):

        """
            The cloud-to-mesh component computes the distance between a point cloud and a mesh

            :param i_cloud_source: a list of point clouds
            :param i_assembly: an assembly of DF beams
            :param i_signed_flag: calculate the sign of the distances
            :param i_swap: swap source and target

            :return o_distances : list of calculated distances for each point
            :return o_rmse: the root mean square error between corresponding points of source and target
            :return o_max_deviation: the max deviation between source and target
            :return o_min_deviation: the min deviation between source and target
            :returns o_results: the results of the comparison all in one object
        """
        if i_analysis_resolution is None:
            scalef = diffCheck.df_util.get_doc_2_meters_unitf()
            i_analysis_resolution = 0.1 / scalef

        # Based on cloud source input + beam size, decide whether to calculate joints or entire assembly and output respective message
        if len(i_assembly.beams) == len(i_cloud_source):
            ghenv.Component.Message = f"Per Beam"
            rh_mesh_target_list = [beam.to_mesh(i_analysis_resolution) for beam in i_assembly.beams]
        elif len(i_assembly.all_joints) == len(i_cloud_source):
            ghenv.Component.Message= f"Per Joint"
            rh_mesh_target_list = [joint.to_mesh(i_analysis_resolution) for joint in i_assembly._all_joints]
        else:
            ghenv.Component.AddRuntimeMessage(RML.Warning, "The input number of obejcts to compare matches neither the number of beams nor the number of joints")
            return None, None, None, None, None, None

        # conversion
        df_cloud_source_list = [df_cvt_bindings.cvt_rhcloud_2_dfcloud(i_cl_s) for i_cl_s in i_cloud_source]


        # calculate distances
        o_result = df_error_estimation.df_cloud_2_rh_mesh_comparison(df_cloud_source_list, rh_mesh_target_list, i_signed_flag, i_swap)

        return o_result.distances, o_result.distances_rmse, o_result.distances_max_deviation, o_result.distances_min_deviation, o_result.distances_sd_deviation, o_result


# if __name__ == "__main__":
#     com = CloudMeshDistance()
#     o_distances, o_rmse, o_max_deviation, o_min_deviation, o_std_deviation, o_results = com.RunScript(
#         i_cloud_source,
#         i_beams,
#         i_signed_flag,
#         i_swap,
#         i_analysis_resolution
#         )
# ---------- end dfcloudmeshdistance ----------
dfvisualization_2 = DFVisualization(i_result=dfcloudmeshdistance.o_result, i_viz_settings=dfvisualizationsettings)  # -> o_colored_geo, o_legend, o_histogram; same code as dfvisualization
